# Dynamo graph Dynamo Prototype.dyn "Paper3_Simulation Demo" (Dynamo 2.12.1.8246)
# packages: archi-lab.net 2023.213.1722

# group: Unflod Lower Facades
select_face_to_unfold = DSFaceSelection()  # 1 picked in the model
byCoordinates = Point.ByCoordinates()
unfoldFacade = Custom[UnfoldFacade](Facade2Unfold=select_face_to_unfold, StartPointofUnfloddedSurface=byCoordinates)  # Unfold selected building facade into 2D surface Output in UnfoldParameters: [0] Unflodded facade [1] Index refers to the shape of the facade, 0 for flat and 1 for curved; [2] Start point in the unflodded paranomic image; [3] End point in the unflodded paranomic image; [4] Hegiht of the unflodded facade; [5] Point on the unflodded facade in Revit; [6] Radius of the arc if exist;
select_face_to_unfold_2 = DSFaceSelection()  # 1 picked in the model
unfoldFacade_2 = Custom[UnfoldFacade](Facade2Unfold=select_face_to_unfold_2, StartPointofUnfloddedSurface=unfoldFacade.EndPointofUnfolddedSurface)
select_face_to_unfold_3 = DSFaceSelection()  # 1 picked in the model
unfoldFacade_3 = Custom[UnfoldFacade](Facade2Unfold=select_face_to_unfold_3, StartPointofUnfloddedSurface=unfoldFacade_2.EndPointofUnfolddedSurface)
select_face_to_unfold_4 = DSFaceSelection()  # 1 picked in the model
unfoldFacade_4 = Custom[UnfoldFacade](Facade2Unfold=select_face_to_unfold_4, StartPointofUnfloddedSurface=unfoldFacade_3.EndPointofUnfolddedSurface)
select_face_to_unfold_5 = DSFaceSelection()  # 1 picked in the model
unfoldFacade_5 = Custom[UnfoldFacade](Facade2Unfold=select_face_to_unfold_5, StartPointofUnfloddedSurface=unfoldFacade_4.EndPointofUnfolddedSurface)
select_face_to_unfold_6 = DSFaceSelection()  # 1 picked in the model
unfoldFacade_6 = Custom[UnfoldFacade](Facade2Unfold=select_face_to_unfold_6, StartPointofUnfloddedSurface=unfoldFacade_5.EndPointofUnfolddedSurface)
select_face_to_unfold_7 = DSFaceSelection()  # 1 picked in the model
unfoldFacade_7 = Custom[UnfoldFacade](Facade2Unfold=select_face_to_unfold_7, StartPointofUnfloddedSurface=unfoldFacade_6.EndPointofUnfolddedSurface)

# group: Unfold upper facades
select_face_to_unfold_8 = DSFaceSelection()  # 1 picked in the model
code_block = CodeBlock { 0; 5000; 0; }
byCoordinates_2 = Point.ByCoordinates(x=code_block.out0, y=code_block.out1, z=code_block.out2)
unfoldFacade_8 = Custom[UnfoldFacade](Facade2Unfold=select_face_to_unfold_8, StartPointofUnfloddedSurface=byCoordinates_2)
select_face_to_unfold_9 = DSFaceSelection()  # 1 picked in the model
unfoldFacade_9 = Custom[UnfoldFacade](Facade2Unfold=select_face_to_unfold_9, StartPointofUnfloddedSurface=unfoldFacade_8.EndPointofUnfolddedSurface)
select_face_to_unfold_10 = DSFaceSelection()  # 1 picked in the model
unfoldFacade_10 = Custom[UnfoldFacade](Facade2Unfold=select_face_to_unfold_10, StartPointofUnfloddedSurface=unfoldFacade_9.EndPointofUnfolddedSurface)
select_face_to_unfold_11 = DSFaceSelection()  # 1 picked in the model
unfoldFacade_11 = Custom[UnfoldFacade](Facade2Unfold=select_face_to_unfold_11, StartPointofUnfloddedSurface=unfoldFacade_10.EndPointofUnfolddedSurface)
select_face_to_unfold_12 = DSFaceSelection()  # 1 picked in the model
unfoldFacade_12 = Custom[UnfoldFacade](Facade2Unfold=select_face_to_unfold_12, StartPointofUnfloddedSurface=unfoldFacade_11.EndPointofUnfolddedSurface)
select_face_to_unfold_13 = DSFaceSelection()  # 1 picked in the model
unfoldFacade_13 = Custom[UnfoldFacade](Facade2Unfold=select_face_to_unfold_13, StartPointofUnfloddedSurface=unfoldFacade_12.EndPointofUnfolddedSurface)
select_face_to_unfold_14 = DSFaceSelection()  # 1 picked in the model
unfoldFacade_14 = Custom[UnfoldFacade](Facade2Unfold=select_face_to_unfold_14, StartPointofUnfloddedSurface=unfoldFacade_13.EndPointofUnfolddedSurface)
select_face_to_unfold_15 = DSFaceSelection()  # 1 picked in the model
unfoldFacade_15 = Custom[UnfoldFacade](Facade2Unfold=select_face_to_unfold_15, StartPointofUnfloddedSurface=unfoldFacade_14.EndPointofUnfolddedSurface)
select_face_to_unfold_16 = DSFaceSelection()  # 1 picked in the model
unfoldFacade_16 = Custom[UnfoldFacade](Facade2Unfold=select_face_to_unfold_16, StartPointofUnfloddedSurface=unfoldFacade_15.EndPointofUnfolddedSurface)
select_face_to_unfold_17 = DSFaceSelection()  # 1 picked in the model
unfoldFacade_17 = Custom[UnfoldFacade](Facade2Unfold=select_face_to_unfold_17, StartPointofUnfloddedSurface=unfoldFacade_16.EndPointofUnfolddedSurface)

# group: Unfold facades into view
drafting_view_to_draw_unfold = Views("Facade Unfold")  # graph input
join = List.Join(list0=unfoldFacade.Unfolding, list1=unfoldFacade_2.Unfolding, list2=unfoldFacade_3.Unfolding, list3=unfoldFacade_4.Unfolding, list4=unfoldFacade_5.Unfolding, list5=unfoldFacade_6.Unfolding, list6=unfoldFacade_7.Unfolding, list7=unfoldFacade_8.Unfolding, list8=unfoldFacade_9.Unfolding, list9=unfoldFacade_10.Unfolding, list10=unfoldFacade_11.Unfolding, list11=unfoldFacade_12.Unfolding, list12=unfoldFacade_13.Unfolding, list13=unfoldFacade_14.Unfolding, list14=unfoldFacade_15.Unfolding, list15=unfoldFacade_16.Unfolding, list16=unfoldFacade_17.Unfolding)
byCurve = DetailCurve.ByCurve(view=drafting_view_to_draw_unfold, curve=join)

list_create = List.Create(item0=unfoldFacade.UnfoldParameters, item1=unfoldFacade_2.UnfoldParameters, item2=unfoldFacade_3.UnfoldParameters, item3=unfoldFacade_4.UnfoldParameters, item4=unfoldFacade_5.UnfoldParameters, item5=unfoldFacade_6.UnfoldParameters, item6=unfoldFacade_7.UnfoldParameters, item7=unfoldFacade_8.UnfoldParameters, item8=unfoldFacade_9.UnfoldParameters, item9=unfoldFacade_10.UnfoldParameters, item10=unfoldFacade_11.UnfoldParameters, item11=unfoldFacade_12.UnfoldParameters, item12=unfoldFacade_13.UnfoldParameters, item13=unfoldFacade_14.UnfoldParameters, item14=unfoldFacade_15.UnfoldParameters, item15=unfoldFacade_16.UnfoldParameters, item16=unfoldFacade_17.UnfoldParameters)
unfold_parameters = Python(IN[0]=list_create)  # CPython3
# ---------- unfold_parameters.python (48 lines) ----------
# Load the Python Standard and DesignScript Libraries
import sys
import clr
import math
clr.AddReference('ProtoGeometry')
from Autodesk.DesignScript.Geometry import *

# The inputs to this node will be stored as a list in the IN variables.
dataEnteringNode = IN

# Place your code below this line
Data = IN[0]

UnfoldParameters = []

PointS = Data[0][5][0][0]
PointM = Data[0][5][1][0]
PointE = Data[0][5][2][0]
PointsF = [PointS,PointM,PointE]
Param = Data[0]
Param[5] = PointsF
SurfaceDir = 0
Param[0].append(SurfaceDir)
UnfoldParameters.append(Param)
PointE0 = PointE
for i in range(len(Data)-1):
	i+=1
	PointS = Data[i][5][0][0]
	PointM = Data[i][5][1][0]
	PointE = Data[i][5][2][0]
	if (abs(PointS.X - PointE0.X)+abs(PointS.Y - PointE0.Y)) < 1:
		PointsF = [PointS,PointM,PointE]
		Param = Data[i]
		Param[5] = PointsF
		Param[0].append(SurfaceDir)
		UnfoldParameters.append(Param)
		PointE0 = PointE
	else:
		PointsF = [PointE,PointM,PointS]
		Param = Data[i]
		Param[5] = PointsF
		SurfaceDir = 1-SurfaceDir
		Param[0].append(SurfaceDir)
		UnfoldParameters.append(Param)
		PointE0 = PointS

# Assign your output to the OUT variable.
OUT = UnfoldParameters
# ----------------------------------------

# group: Project camera view points
planned_uav_path = Filename(".\Simulation View Points.xlsx")
file_from_path = FileObject(path=planned_uav_path)
code_block_2 = CodeBlock { "GPS"; }
importExcel = Data.ImportExcel(file=file_from_path, sheetName=code_block_2)
show_lines = Python(IN[0]=importExcel)  # CPython3; frozen; unwired: IN[1]
# ---------- show_lines.python (43 lines) ----------
# Load the Python Standard and DesignScript Libraries
import sys
import clr
clr.AddReference('ProtoGeometry')
from Autodesk.DesignScript.Geometry import *

#导入revit节点，如果要使用revit节点中的方法
clr.AddReference("RevitNodes")
from Revit.Elements import *

import os
localapp = os.getenv(r'LOCALAPPDATA')
sys.path.append(os.path.join(localapp, r'python-3.8.3-embed-amd64\Lib\site-packages'))
import numpy as np
import math

# The inputs to this node will be stored as a list in the IN variables.
dataEnteringNode = IN

# Place your code below this line
NameGPS = IN[0]
polySurface = IN[1]

UAVLines = []
#Set distamce value to calulate target point based on view point

for temp in NameGPS:
    ViewName = temp[0]
    x1 = temp[1]*1000
    y1 = temp[2]*1000
    z1 = temp[3]*1000
    yaw = (temp[4]-90)*math.pi/180
    pitch = temp[5]*math.pi/180
    P1 = Point.ByCoordinates(x1,y1,z1)
    x2 = x1 - 11000*np.sin(yaw)*np.cos(pitch)
    y2 = y1 + 11000*np.cos(yaw)*np.cos(pitch)
    z2 = z1 - 11000*np.sin(pitch)
    P2 = Point.ByCoordinates(x2,y2,z2)
    LineUAV = Line.ByStartPointEndPoint(P1,P2)
    UAVLines.append(LineUAV)

# Assign your output to the OUT variable.
OUT = UAVLines
# ----------------------------------------
uav_camera_view_centre = Python(IN[0]=unfold_parameters, IN[1]=importExcel)  # CPython3
# ---------- uav_camera_view_centre.python (82 lines) ----------
# Load the Python Standard and DesignScript Libraries
import sys
import clr
clr.AddReference('ProtoGeometry')
from Autodesk.DesignScript.Geometry import *

#导入revit节点，如果要使用revit节点中的方法
clr.AddReference("RevitNodes")
from Revit.Elements import *

import os
localapp = os.getenv(r'LOCALAPPDATA')
sys.path.append(os.path.join(localapp, r'python-3.8.3-embed-amd64\Lib\site-packages'))
import numpy as np
import math

# The inputs to this node will be stored as a list in the IN variables.
dataEnteringNode = IN

# Place your code below this line
NameGPS = IN[1]
UnfoldData = IN[0]

UAVviewpoints = []
Surfaces = []
for i in range(len(UnfoldData)):
    UAVviewpoints.append([])
    Surfaces.append(UnfoldData[i][0][0])

#Calculate the UAV camera view centre in 3D BIM model
for temp in NameGPS:
    ViewName = temp[0]
    x1 = temp[1]*1000
    y1 = temp[2]*1000
    z1 = temp[3]*1000
    yaw = (temp[4]-90)*math.pi/180
    pitch = temp[5]*math.pi/180
    P1 = Point.ByCoordinates(x1,y1,z1)
    x2 = x1 - 11000*np.sin(yaw)*np.cos(pitch)
    y2 = y1 + 11000*np.cos(yaw)*np.cos(pitch)
    z2 = z1 - 11000*np.sin(pitch)
    P2 = Point.ByCoordinates(x2,y2,z2)
    LineUAV = Line.ByStartPointEndPoint(P1,P2)
    for i in range(len(Surfaces)):
        surf = Surfaces[i]
        inter = Geometry.Intersect(surf,LineUAV)
        if len(inter) == 1:
            UAVview = [ViewName,inter]
            UAVviewpoints[i].append(UAVview)
    #UAVview = [ViewName,inter]
    #UAVviewpoints.append(UAVview)

#Porject the UAV camera view centre from BIM to the 2D unflodded plane
UAVviewpointsUnfold = []
for i in range(len(UnfoldData)):
    UAVviewpointsUnfold.append([])
    unfoldParam = UnfoldData[i]
    x0 = unfoldParam[5][0].X
    y0 = unfoldParam[5][0].Y
    u0 = unfoldParam[2].X
    if unfoldParam[1] == 0:
        for points in UAVviewpoints[i]:
            x1 = points[1][0].X
            y1 = points[1][0].Y
            z1 = points[1][0].Z
            d = ((x1-x0)**2 + (y1-y0)**2)**0.5
            u = u0 + d
            v = z1
            UAVviewpointsUnfold[i].append([points[0],[round(u),round(v)]])
    else:
        for points in UAVviewpoints[i]:
            x1 = points[1][0].X
            y1 = points[1][0].Y
            z1 = points[1][0].Z
            d = ((x1-x0)**2 + (y1-y0)**2)**0.5
            r = unfoldParam[6]
            u = u0 + 2*r*np.arcsin(d/(2*r))
            v = z1
            UAVviewpointsUnfold[i].append([points[0],[round(u),round(v)]])

# Assign your output to the OUT variable.
OUT = [UAVviewpoints,UAVviewpointsUnfold]
# ----------------------------------------

panoramic_image_unscaled = Python(IN[0]=unfold_parameters, IN[1]=uav_camera_view_centre)  # CPython3
# ---------- panoramic_image_unscaled.python (255 lines) ----------
# Load the Python Standard and DesignScript Libraries
import sys
import clr
clr.AddReference('ProtoGeometry')
from Autodesk.DesignScript.Geometry import *

#导入revit节点，如果要使用revit节点中的方法
clr.AddReference("RevitNodes")
from Revit.Elements import *

import os
localapp = os.getenv(r'LOCALAPPDATA')
sys.path.append(os.path.join(localapp, r'python-3.8.3-embed-amd64\Lib\site-packages'))
import numpy as np
import cv2
import math
from scipy.spatial import Voronoi, voronoi_plot_2d

# The inputs to this node will be stored as a list in the IN variables.
dataEnteringNode = IN

# Place your code below this line
UnfoldParameters = IN[0]
UAVviewpoints = IN[1][1]

facadeCorners = []
Xmax = 0
Ymax = 0
for unfoldData in UnfoldParameters:
    if Xmax < unfoldData[3].X:
        Xmax = unfoldData[3].X
    if Ymax < unfoldData[3].Y + unfoldData[4][0]:
        Ymax = unfoldData[3].Y + unfoldData[4][0]

PanoramicReso = [int(Ymax), int(Xmax)]
PanoramicImg = np.zeros((int(Ymax), int(Xmax), 3), np.uint8)
PanoramicImgSeg = np.zeros((int(Ymax), int(Xmax), 3), np.uint8)
###project the corners of each facade into the nunfoldded panoramic image
for unfoldData in UnfoldParameters: 
    P1 = (int(unfoldData[2].X), int(Ymax) - int(unfoldData[2].Y))
    P2 = (int(unfoldData[3].X), int(Ymax) - int(unfoldData[3].Y))
    P3 = (int(unfoldData[3].X), int(Ymax) - int(unfoldData[3].Y) - int(unfoldData[4][0]))
    P4 = (int(unfoldData[2].X), int(Ymax) - int(unfoldData[2].Y) - int(unfoldData[4][0]))
    cv2.line(PanoramicImg, P1, P2, (255,255,255),9)
    cv2.line(PanoramicImg, P2, P3, (255,255,255),9)
    cv2.line(PanoramicImg, P3, P4, (255,255,255),9)
    cv2.line(PanoramicImg, P1, P4, (255,255,255),9)
    facadeCorners.append([P1,P2,P3,P4])

###project the UAV view centre point into the unfoldded panoramic image
UAVviewpointsPara = []
for i in range(len(UAVviewpoints)): 
    UAVviewpointsPara.append([])
    UAVviews = UAVviewpoints[i]
    for view in UAVviews:
        viewX = view[1][0]
        viewY = view[1][1]
        viewCenter = (int(viewX), int(Ymax) - int(viewY))
        cv2.circle(PanoramicImg, viewCenter, 20, (255,255,255), 9)
        UAVviewpointsPara[i].append([view[0],viewCenter])

#cv2.imwrite('C:/Users/czha626/OneDrive - The University of Auckland/Desktop/PanoramicImg.jpg',PanoramicImg)
#cv2.imwrite('C:/Users/19644/Desktop/PanoramicImg.jpg',PanoramicImg)

PanoramicSegmentation = []
for i in range(len(facadeCorners)):
    PanoramicSegmentation.append([])
    facadeNum = i
    Fcorner = facadeCorners[i]
    Xmin = 10000000000
    Xmax = 0
    Ymin = 10000000000
    Ymax = 0
    for points in Fcorner:
        if Xmin > points[0]:
            Xmin = points[0]
        if Xmax < points[0]:
            Xmax = points[0]
        if Ymin > points[1]:
            Ymin = points[1]
        if Ymax < points[1]:
            Ymax = points[1]
    
    UAVviewpointsP = UAVviewpointsPara[i]
    if UAVviewpointsP:
        UAVimageName = []
        UAVview = []
        UAVviewX = []
        UAVviewY = []
        for UAVviewpoints in UAVviewpointsP:
            if abs(UAVviewpoints[1][0]-Xmin) > 1000 and abs(UAVviewpoints[1][0]-Xmax) > 1000 and abs(UAVviewpoints[1][1]-Ymin) > 1000 and abs(UAVviewpoints[1][1]-Ymax) > 1000:
                UAVimageName.append(UAVviewpoints[0])
                UAVview.append([UAVviewpoints[1][0], UAVviewpoints[1][1]])
                UAVviewX.append(UAVviewpoints[1][0])
                UAVviewY.append(UAVviewpoints[1][1])
                #cv2.circle(PanoramicImgSeg, (UAVviewpoints[1][0], UAVviewpoints[1][1]), 20, (255,255,255), 9)
        if np.var(UAVviewX) < 10: ###if all the UAV view centre points are in one colum, i.e.,parallar to the y-axis
            RegionVertices = []
            lengt = len(UAVview)
            
            RegionVertices.append([])
            y1 = (UAVview[0][1] + UAVview[1][1])/2
            if UAVview[0][1] < UAVview[1][1]:
                RegionVertices[0].append([Xmin,Ymin])
                RegionVertices[0].append([Xmax,Ymin])
                RegionVertices[0].append([Xmin,y1])
                RegionVertices[0].append([Xmax,y1])
            else:
                RegionVertices[0].append([Xmin,Ymax])
                RegionVertices[0].append([Xmax,Ymax])
                RegionVertices[0].append([Xmin,y1])
                RegionVertices[0].append([Xmax,y1])
            
            for i in range(lengt-2):
                RegionVertices.append([])
                yymin = (UAVview[i][1] + UAVview[i+1][1])/2
                yymax = (UAVview[i+1][1] + UAVview[i+2][1])/2
                RegionVertices[i+1].append([Xmin,yymin])
                RegionVertices[i+1].append([Xmax,yymin])
                RegionVertices[i+1].append([Xmin,yymax])
                RegionVertices[i+1].append([Xmax,yymax])
            
            RegionVertices.append([])
            y2 = (UAVview[lengt-1][1] + UAVview[lengt-2][1])/2
            if UAVview[0][1] < UAVview[1][1]:
                RegionVertices[lengt-1].append([Xmin,Ymax])
                RegionVertices[lengt-1].append([Xmax,Ymax])
                RegionVertices[lengt-1].append([Xmin,y2])
                RegionVertices[lengt-1].append([Xmax,y2])
            else:
                RegionVertices[lengt-1].append([Xmin,Ymin])
                RegionVertices[lengt-1].append([Xmax,Ymin])
                RegionVertices[lengt-1].append([Xmin,y2])
                RegionVertices[lengt-1].append([Xmax,y2])
        elif np.var(UAVviewY) < 10: ###if all the UAV view centre points are in one row, i.e.,parallar to the x-axis
            RegionVertices = []
            lengt = len(UAVview)
            
            RegionVertices.append([])
            x1 = (UAVview[0][0] + UAVview[1][0])/2
            if UAVview[0][0] < UAVview[1][0]:
                RegionVertices[0].append([Xmin,Ymin])
                RegionVertices[0].append([x1,Ymin])
                RegionVertices[0].append([Xmin,Ymax])
                RegionVertices[0].append([x1,Ymax])
            else:
                RegionVertices[0].append([x1,Ymin])
                RegionVertices[0].append([Xmax,Ymin])
                RegionVertices[0].append([x1,Ymax])
                RegionVertices[0].append([Xmax,Ymax])
            
            for i in range(lengt-2):
                RegionVertices.append([])
                xxmin = (UAVview[i][0] + UAVview[i+1][0])/2
                xxmax = (UAVview[i+1][0] + UAVview[i+2][0])/2
                RegionVertices[i+1].append([xxmin,Ymin])
                RegionVertices[i+1].append([xxmax,Ymin])
                RegionVertices[i+1].append([xxmin,Ymax])
                RegionVertices[i+1].append([xxmax,Ymax])
            
            RegionVertices.append([])
            x2 = (UAVview[lengt-1][0] + UAVview[lengt-2][0])/2
            if UAVview[0][0] < UAVview[1][0]:
                RegionVertices[0].append([x2,Ymin])
                RegionVertices[0].append([Xmax,Ymin])
                RegionVertices[0].append([x2,Ymax])
                RegionVertices[0].append([Xmax,Ymax])
            else:
                RegionVertices[0].append([Xmin,Ymin])
                RegionVertices[0].append([x2,Ymin])
                RegionVertices[0].append([Xmin,Ymax])
                RegionVertices[0].append([x2,Ymax])
        else: ###if all the UAV view centre points are in multiple colums or rows
            vor = Voronoi(UAVview)
            RegionVertices = []
            for i in range(len(UAVview)):
                UAVpoint = UAVview[i]
                RegionVertices.append([])
                index_region = vor.point_region[i]
                index_vertices = vor.regions[index_region]
                if -1 in index_vertices:
                    if len(index_vertices) == 2:
                        for ind in index_vertices:
                            if ind != -1:
                                vertice = list(vor.vertices[ind])
                                RegionVertices[i].append(vertice)
                        if UAVpoint[0] < vertice[0]:
                            if UAVpoint[1] < vertice[1]:
                                RegionVertices[i].append([Xmin,Ymin])
                                RegionVertices[i].append([Xmin,vertice[1]])
                                RegionVertices[i].append([vertice[0],Ymin])
                            else:
                                RegionVertices[i].append([Xmin,Ymax])
                                RegionVertices[i].append([Xmin,vertice[1]])
                                RegionVertices[i].append([vertice[0],Ymax])
                        else:
                            if UAVpoint[1] < vertice[1]:
                                RegionVertices[i].append([Xmax,Ymin])
                                RegionVertices[i].append([Xmax,vertice[1]])
                                RegionVertices[i].append([vertice[0],Ymin])
                            else:
                                RegionVertices[i].append([Xmax,Ymax])
                                RegionVertices[i].append([Xmax,vertice[1]])
                                RegionVertices[i].append([vertice[0],Ymax])
                    else:
                        for ind in index_vertices:
                            if ind != -1:
                                vertice = list(vor.vertices[ind])
                                RegionVertices[i].append(vertice)
                        if abs(RegionVertices[i][0][0]-RegionVertices[i][1][0]) < abs(RegionVertices[i][0][1]-RegionVertices[i][1][1]):
                            if UAVpoint[0] < vertice[0]:
                                RegionVertices[i].append([Xmin,RegionVertices[i][0][1]])
                                RegionVertices[i].append([Xmin,RegionVertices[i][1][1]])
                            else:
                                RegionVertices[i].append([Xmax,RegionVertices[i][0][1]])
                                RegionVertices[i].append([Xmax,RegionVertices[i][1][1]])
                        else:
                            if UAVpoint[1] < vertice[1]:
                                RegionVertices[i].append([RegionVertices[i][0][0],Ymin])
                                RegionVertices[i].append([RegionVertices[i][1][0],Ymin])
                            else:
                                RegionVertices[i].append([RegionVertices[i][0][0],Ymax])
                                RegionVertices[i].append([RegionVertices[i][1][0],Ymax])
                else:
                    for ind in index_vertices:
                        vertice = list(vor.vertices[ind])
                        RegionVertices[i].append(vertice)
    
        PanoramicSegmentation[facadeNum] = [UAVimageName,RegionVertices]

for i in range(len(PanoramicSegmentation)):
    PanoramicSeg = PanoramicSegmentation[i]
    if PanoramicSeg:
        corners = PanoramicSeg[1]
        for corner in corners:
             Xmin = 100000
             Xmax = 0
             Ymin = 100000
             Ymax = 0
             for points in corner:
                if Xmin > points[0]:
                    Xmin = points[0]
                if Xmax < points[0]:
                    Xmax = points[0]
                if Ymin > points[1]:
                    Ymin = points[1]
                if Ymax < points[1]:
                    Ymax = points[1]
             cv2.rectangle(PanoramicImgSeg, (int(Xmin),int(Ymin)),(int(Xmax),int(Ymax)), (255,0,0), 9)
    
#cv2.imwrite('C:/Users/czha626/OneDrive - The University of Auckland/Desktop/PanoramicImgSeg.jpg',PanoramicImgSeg)
#cv2.imwrite('C:/Users/19644/Desktop/PanoramicImgSeg.jpg',PanoramicImg)
# Assign your output to the OUT variable.
#OUT = [facadeCorners,UAVviewpointsPara,Xmax,Ymax]
OUT = [PanoramicSegmentation, PanoramicReso, facadeCorners]
# ----------------------------------------
camera_pose_sfm = Filename(".\SfM results.xml")  # graph input
texture_panoramic_image = Python(IN[0]=panoramic_image_unscaled, IN[1]=camera_pose_sfm, IN[2]=unfold_parameters)  # CPython3
# ---------- texture_panoramic_image.python (213 lines) ----------
# Load the Python Standard and DesignScript Libraries
import sys
import clr
clr.AddReference('ProtoGeometry')
from Autodesk.DesignScript.Geometry import *

#导入revit节点，如果要使用revit节点中的方法
clr.AddReference("RevitNodes")
from Revit.Elements import *

import os
localapp = os.getenv(r'LOCALAPPDATA')
sys.path.append(os.path.join(localapp, r'python-3.8.3-embed-amd64\Lib\site-packages'))
import numpy as np
import cv2
import math
import xml.etree.ElementTree as ET

def extract_XML_pose(xml_file_path): #read rotation and translation metrix from xml file
    tree = ET.parse(xml_file_path)
    root = tree.getroot()

    rotation_elements = root.findall('.//Rotation')

    rotation_matrices = []
    # To get the text content of an element
    for rotation_element in rotation_elements:
        M00_element = rotation_element.find('.//M_00')
        M01_element = rotation_element.find('.//M_01')
        M02_element = rotation_element.find('.//M_02')
        M10_element = rotation_element.find('.//M_10')
        M11_element = rotation_element.find('.//M_11')
        M12_element = rotation_element.find('.//M_12')
        M20_element = rotation_element.find('.//M_20')
        M21_element = rotation_element.find('.//M_21')
        M22_element = rotation_element.find('.//M_22')
        matrix_values_00 = float(M00_element.text.split()[0])
        matrix_values_01 = float(M01_element.text.split()[0])
        matrix_values_02 = float(M02_element.text.split()[0])
        matrix_values_10 = float(M10_element.text.split()[0])
        matrix_values_11 = float(M11_element.text.split()[0])
        matrix_values_12 = float(M12_element.text.split()[0])
        matrix_values_20 = float(M20_element.text.split()[0])
        matrix_values_21 = float(M21_element.text.split()[0])
        matrix_values_22 = float(M22_element.text.split()[0])
        matrix_values = np.array([[matrix_values_00, matrix_values_01, matrix_values_02],
                                  [matrix_values_10, matrix_values_11, matrix_values_12],
                                  [matrix_values_20, matrix_values_21, matrix_values_22]])
        rotation_matrices.append(matrix_values)

    translation_elements = root.findall('.//Pose/Center')
    translation_matrices = []
    for translation_element in translation_elements:
        x_element = translation_element.find('.//x')
        y_element = translation_element.find('.//y')
        z_element = translation_element.find('.//z')
        matrix_values_x = float(x_element.text.split()[0])
        matrix_values_y = float(y_element.text.split()[0])
        matrix_values_z = float(z_element.text.split()[0])
        translation_matrice = np.array([matrix_values_x,matrix_values_y,matrix_values_z])
        translation_matrices.append(translation_matrice)
    
    img_elements = root.findall('.//ImagePath')
    imgPath_matrices = []
    for img_element in img_elements:
        imgPath = img_element.text
        imgPath_matrices.append(imgPath)
    
    return rotation_matrices, translation_matrices, imgPath_matrices

def inversMatrix(rotation_matrix,translation_vector):
    rotation_matrix_1 = np.linalg.inv(rotation_matrix)
    
    extrinsic_matrix = np.eye(4)
    extrinsic_matrix[:3, :3] = rotation_matrix_1
    extrinsic_matrix[:3, 3] = translation_vector
    
    extrinsic_matrix_inv = np.linalg.inv(extrinsic_matrix)

    rotation_matrix_inv = extrinsic_matrix_inv[:3,:3]
    translation_vector_inv = extrinsic_matrix_inv[:3,3]
    
    return rotation_matrix_inv, translation_vector_inv

def RegionEdge(corners, PanoGSD):
    Xmin = 10000000000000
    Xmax = 0
    Ymin = 10000000000000
    Ymax = 0
    for points in corners:
        if Xmin > points[0]:
            Xmin = points[0]
        if Xmax < points[0]:
            Xmax = points[0]
        if Ymin > points[1]:
            Ymin = points[1]
        if Ymax < points[1]:
            Ymax = points[1]
    Xmin = int(Xmin/PanoGSD)
    Xmax = int(Xmax/PanoGSD)
    Ymin = int(Ymin/PanoGSD)
    Ymax = int(Ymax/PanoGSD)
    return Xmin, Xmax, Ymin, Ymax

# The inputs to this node will be stored as a list in the IN variables.
PanoramicSegmentation = IN[0][0]
PanoramicReso = IN[0][1]
facadeCorners = IN[0][2]
xml_file_path = IN[1]
unfoldParameters = IN[2]
# Place your code below this line
rotation_matrices, translation_matrices, imgPath_matrices = extract_XML_pose(xml_file_path) # read the recovered camera pose and position
f = 4.11151852017505
intrinsic_matrix = np.array([[f*4056/6.17, 0, 2028],
                             [0, f*4056/6.17, 1520],
                             [0, 0, 1]])

###file root of the test
file_root = r'D:\Test'

PanoGSD = 5
PanoramicImg = np.zeros((int(PanoramicReso[0]/PanoGSD), int(PanoramicReso[1]/PanoGSD), 3), np.uint8)
PanoramicSize = (PanoramicImg.shape[1], PanoramicImg.shape[0])

corners_bim = []
corners_uav = []
for i in range(len(PanoramicSegmentation)):
    img_all = PanoramicSegmentation[i][0]
    corners_all = PanoramicSegmentation[i][1]
    unfoldParam = unfoldParameters[i]
    u0 = unfoldParam[2].X
    x0 = unfoldParam[5][0].X
    y0 = unfoldParam[5][0].Y
    x1 = unfoldParam[5][2].X
    y1 = unfoldParam[5][2].Y
    corners_bim.append([])
    corners_uav.append([])
    for j in range(len(img_all)):
        if int(img_all[j]) < 75:
            img_index = int(img_all[j])-1
        else:
            img_index = int(img_all[j])-2
        
        imgPath = imgPath_matrices[img_index]
        UAVimg = cv2.imread(imgPath,1)
        rotation_matrix = rotation_matrices[img_index]
        translation_vector = translation_matrices[img_index]
        rotation_matrix_inv, translation_vector_inv = inversMatrix(rotation_matrix,translation_vector)
        corners = corners_all[j]
        Xmin, Xmax, Ymin, Ymax = RegionEdge(corners, PanoGSD)
        
        corners_scaled = []
        corner_bim = []
        corner_uav = []
        if unfoldParam[1] == 0: # if building surface is a plane, then using perspective transform to map UAV image onto panoramic image based on the four corners
            for corner in corners:
                d = corner[0]-u0
                x_bim = x0 + d*(x1-x0)/(((x1-x0)**2 + (y1-y0)**2)**0.5)
                y_bim = y0 + d*(y1-y0)/(((x1-x0)**2 + (y1-y0)**2)**0.5)
                z_bim = PanoramicReso[0] - corner[1]
                corner_bim.append([x_bim, y_bim, z_bim])
                corners_scaled.append([corner[0]/PanoGSD, corner[1]/PanoGSD])
                
                point_3d = np.array([x_bim/1000, y_bim/1000, (z_bim+160)/1000])
                #rotation_matrix_inv, translation_vector_inv = inversMatrix(rotation_matrix,translation_vector)
                uav_points = cv2.projectPoints(point_3d.reshape(1,1,3), rotation_matrix_inv, translation_vector_inv, intrinsic_matrix, distCoeffs=None)
                uav_points_list = uav_points[0][0][0].tolist()
                corner_uav.append([uav_points_list[0], uav_points_list[1]])
        
            src = np.float32(corner_uav)
            dst = np.float32(corners_scaled)
            PerspectiveT, mask = cv2.findHomography(src, dst, cv2.RANSAC, 5.0)
            PerspectiveResult = cv2.warpPerspective(UAVimg, PerspectiveT, PanoramicSize, borderMode=cv2.BORDER_CONSTANT, borderValue=(0,0,0))
            
            PerspectiveResultCropped = np.zeros((int(PanoramicReso[0]/PanoGSD), int(PanoramicReso[1]/PanoGSD), 3), np.uint8)
            PerspectiveResultCropped[Ymin:Ymax, Xmin:Xmax] = PerspectiveResult[Ymin:Ymax, Xmin:Xmax] # crop the image to the region of interest
            #Perspective_Path = file_root+'/Perspective/'+str(img_all[j])+'.jpg'
            #cv2.imwrite(Perspective_Path,PerspectiveResultCropped)
            
            PanoramicImg = PanoramicImg + PerspectiveResultCropped
        
            corners_bim[i].append(corner_bim)
            corners_uav[i].append(corner_uav)
        elif unfoldParam[1] == 1: # if building surface is a curve, then calculate pixel information for each point in panoramic image
            curve_f = Arc.ByThreePoints(unfoldParam[5][0], unfoldParam[5][1], unfoldParam[5][2]) #curve of the unfoldded facade
            for x in range(Xmin, Xmax):
                for y in range(Ymin, Ymax):
                    d = x*PanoGSD - u0
                    
                    P_bim = Curve.PointAtSegmentLength(curve_f, d)
                    x_bim = P_bim.X
                    y_bim = P_bim.Y
                    z_bim = PanoramicReso[0] - y*PanoGSD
                    
                    point_3d = np.array([x_bim/1000, y_bim/1000, (z_bim+160)/1000])
                    uav_points = cv2.projectPoints(point_3d.reshape(1,1,3), rotation_matrix_inv, translation_vector_inv, intrinsic_matrix, distCoeffs=None)
                    uav_points_list = uav_points[0][0][0].tolist()
                    PanoramicImg[y,x] = UAVimg[int(uav_points_list[1]), int(uav_points_list[0])]

Panoramic_Path = file_root+'/PanoramicImg.jpg'
cv2.imwrite(Panoramic_Path,PanoramicImg)

facade_paths = []
for i in range(len(facadeCorners)): #segment the panoramic image for each facade
    facadeCorner = facadeCorners[i]
    F_Xmin, F_Xmax, F_Ymin, F_Ymax = RegionEdge(facadeCorner, PanoGSD)
    FacadeImg = PanoramicImg[F_Ymin:F_Ymax, F_Xmin:F_Xmax]
    facade_path = file_root+'/Facade'+str(i)+'.jpg'
    facade_paths.append(facade_path)
    cv2.imwrite(facade_path,FacadeImg)

# Assign your output to the OUT variable.
OUT = [Panoramic_Path, facade_paths, unfoldParameters, corners_bim, corners_uav, PanoramicSize]
# ----------------------------------------

# group: Import image into 2D view
inspection_result_view = Views("Facade Inspection")  # graph input
code_block_3 = CodeBlock(Result=texture_panoramic_image) { Panoramic_Path = Result[0]; }
create = archilab.Revit.Elements.ImageTypeOptions.Create(filePath=code_block_3)
create_2 = archilab.Revit.Elements.ImageTypes.Create(imageTypeOptions=create)
code_block_4 = CodeBlock { Point.ByCoordinates(0,0); }
box_placement_types = BoxPlacementTypeUi("TopLeft")
create_3 = archilab.Revit.Elements.ImagePlacementOptions.Create(location=code_block_4, boxPlacementType=box_placement_types)
create_4 = archilab.Revit.Elements.ImageInstances.Create(view=inspection_result_view, imageType=create_2, imagePlacementOptions=create_3)
code_block_5 = CodeBlock { "Height"; 14000; }
setParameterByName = Element.SetParameterByName(element=create_4, parameterName=code_block_5.out0, value=code_block_5.out1)

# group: Paint 3D model with inspection image
code_block_6 = CodeBlock { "InspectionImageFacade0"; }
byName = Material.ByName(name=code_block_6)
code_block_7 = CodeBlock { "InspectionImageFacade1"; }
byName_2 = Material.ByName(name=code_block_7)
code_block_8 = CodeBlock { "InspectionImageFacade2"; }
byName_3 = Material.ByName(name=code_block_8)
code_block_9 = CodeBlock { "InspectionImageFacade3"; }
byName_4 = Material.ByName(name=code_block_9)
code_block_10 = CodeBlock { "InspectionImageFacade4"; }
byName_5 = Material.ByName(name=code_block_10)
code_block_11 = CodeBlock { "InspectionImageFacade5"; }
byName_6 = Material.ByName(name=code_block_11)
code_block_12 = CodeBlock { "InspectionImageFacade6"; }
byName_7 = Material.ByName(name=code_block_12)
code_block_13 = CodeBlock { "InspectionImageFacade7"; }
byName_8 = Material.ByName(name=code_block_13)
code_block_14 = CodeBlock { "InspectionImageFacade8"; }
byName_9 = Material.ByName(name=code_block_14)
code_block_15 = CodeBlock { "InspectionImageFacade9"; }
byName_10 = Material.ByName(name=code_block_15)
code_block_16 = CodeBlock { "InspectionImageFacade10"; }
byName_11 = Material.ByName(name=code_block_16)
code_block_17 = CodeBlock { "InspectionImageFacade11"; }
byName_12 = Material.ByName(name=code_block_17)
code_block_18 = CodeBlock { "InspectionImageFacade12"; }
byName_13 = Material.ByName(name=code_block_18)
code_block_19 = CodeBlock { "InspectionImageFacade13"; }
byName_14 = Material.ByName(name=code_block_19)
code_block_20 = CodeBlock { "InspectionImageFacade14"; }
byName_15 = Material.ByName(name=code_block_20)
code_block_21 = CodeBlock { "InspectionImageFacade15"; }
byName_16 = Material.ByName(name=code_block_21)
code_block_22 = CodeBlock { "InspectionImageFacade16"; }
byName_17 = Material.ByName(name=code_block_22)
materials = List.Create(item0=byName, item1=byName_2, item2=byName_3, item3=byName_4, item4=byName_5, item5=byName_6, item6=byName_7, item7=byName_8, item8=byName_9, item9=byName_10, item10=byName_11, item11=byName_12, item12=byName_13, item13=byName_14, item14=byName_15, item15=byName_16, item16=byName_17)
texture_3d_model_using_materials = Python(IN[0]=texture_panoramic_image, IN[1]=materials)  # IronPython2
# ---------- texture_3d_model_using_materials.python (168 lines) ----------
import clr
import sys
clr.AddReference('ProtoGeometry')
from Autodesk.DesignScript.Geometry import *

import Autodesk

clr.AddReference('RevitAPI')
from Autodesk.Revit.DB import *
from Autodesk.Revit.DB.Visual import *

clr.AddReference('RevitServices')
import RevitServices
from RevitServices.Persistence import DocumentManager
from RevitServices.Transactions import TransactionManager
doc = DocumentManager.Instance.CurrentDBDocument
uiapp = DocumentManager.Instance.CurrentUIApplication
app = uiapp.Application
version=int(app.VersionNumber)
clr.AddReference('RevitNodes')
import Revit
clr.ImportExtensions(Revit.Elements)
clr.ImportExtensions(Revit.GeometryConversion)

def toList(obj):
    if hasattr(obj, '__iter__'): return obj
    else: return [obj]

def PaintFace(surf, mat):
	if not isinstance(surf, list):
		elemRef = surf.Tags.LookupTag('RevitFaceReference')
		elem = doc.GetElement(elemRef)
		face = elem.GetGeometryObjectFromReference(elemRef)
		if not (doc.IsPainted(elem.Id, face)):
			doc.Paint(elem.Id, face, mat.Id)
			return surf
	else:
		[PaintFace(i, mat) for i in surf]
		return surf

mats = toList(UnwrapElement(IN[1]))

file_path = IN[0][1]
paths = toList(file_path)

unfoldParameters = IN[0][2]
surfaces = []
scaleWidhts = []
scaleHeights = []
for i in range(len(unfoldParameters)):
	surfaces.append(unfoldParameters[i][0][0])
	width = (unfoldParameters[i][3].X - unfoldParameters[i][2].X)*12
	scaleWidhts.append(width)
	height = unfoldParameters[i][4][0]*12
	scaleHeights.append(height)

for mat, texturePath in zip(mats, paths):
	appearanceAssetId = mat.AppearanceAssetId
	assetElem = doc.GetElement(appearanceAssetId)
	TransactionManager.Instance.EnsureInTransaction(doc)
	with Visual.AppearanceAssetEditScope(doc) as editScope:
		editableAsset = editScope.Start(assetElem.Id)
		if (editableAsset.FindByName("BaseSchema")).Value == "GenericSchema":
			property = editableAsset.FindByName("generic_diffuse")
		elif (editableAsset.FindByName("BaseSchema")).Value == "CeramicSchema":
			property = editableAsset.FindByName("ceramic_color")
		elif (editableAsset.FindByName("BaseSchema")).Value == "ConcreteSchema":
			property = editableAsset.FindByName("concrete_color")
		elif (editableAsset.FindByName("BaseSchema")).Value == "MetallicPaintSchema":
			property = editableAsset.FindByName("metallicpaint_base_color")
		elif (editableAsset.FindByName("BaseSchema")).Value == "MasonryCMUSchema":
			property = editableAsset.FindByName("masonrycmu_color")	
		elif (editableAsset.FindByName("BaseSchema")).Value == "PlasticVinylSchema":
			property = editableAsset.FindByName("plasticvinyl_color")
		elif (editableAsset.FindByName("BaseSchema")).Value == "HardwoodSchema":
			property = editableAsset.FindByName("hardwood_color")
		elif (editableAsset.FindByName("BaseSchema")).Value == "StoneSchema":
			property = editableAsset.FindByName("stone_color")	
		elif (editableAsset.FindByName("BaseSchema")).Value == "SolidGlassSchema":
			property = editableAsset.FindByName("solidglass_transmittance_custom_color")
		elif (editableAsset.FindByName("BaseSchema")).Value == "PrismLayeredSchema":
			property = editableAsset.FindByName("layered_diffuse")
		elif (editableAsset.FindByName("BaseSchema")).Value == "PrismMetalSchema":
			property = editableAsset.FindByName("surface_roughness")			
		elif (editableAsset.FindByName("BaseSchema")).Value == "PrismOpaqueSchema":
			property = editableAsset.FindByName("opaque_albedo")
		elif (editableAsset.FindByName("BaseSchema")).Value == "PrismTransparentSchema":
			property = editableAsset.FindByName("surface_roughness")
		if property.NumberOfConnectedProperties == 0 :
			property.AddConnectedAsset("UnifiedBitmapSchema")
			connectedAsset = property.GetConnectedProperty(0)
			path = connectedAsset.FindByName("unifiedbitmap_Bitmap")
			path.Value = texturePath
			editScope.Commit(True)
	TransactionManager.Instance.TransactionTaskDone()


if version < 2021:
	UIunit = doc.GetUnits().GetFormatOptions(UnitType.UT_Length).DisplayUnits
else:
	UIunit = doc.GetUnits().GetFormatOptions(SpecTypeId.Length).GetUnitTypeId()

k = 0
for mat, path in zip(mats, paths):
	assetElem = doc.GetElement(mat.AppearanceAssetId)
	TransactionManager.Instance.EnsureInTransaction(doc)
	scaleWidht = scaleWidhts[k]
	scaleHeight = scaleHeights[k]
	k = k+1
	with Visual.AppearanceAssetEditScope(doc) as editScope:
		editableAsset = editScope.Start(assetElem.Id)
		if (editableAsset.FindByName("BaseSchema")).Value == "GenericSchema":
			property = editableAsset.FindByName(Generic.GenericDiffuse)
		elif (editableAsset.FindByName("BaseSchema")).Value == "CeramicSchema":
			property = editableAsset.FindByName("ceramic_color")
		elif (editableAsset.FindByName("BaseSchema")).Value == "ConcreteSchema":
			property = editableAsset.FindByName("concrete_color")
		elif (editableAsset.FindByName("BaseSchema")).Value == "MetallicPaintSchema":
			property = editableAsset.FindByName("metallicpaint_base_color")
		elif (editableAsset.FindByName("BaseSchema")).Value == "MasonryCMUSchema":
			property = editableAsset.FindByName("masonrycmu_color")	
		elif (editableAsset.FindByName("BaseSchema")).Value == "PlasticVinylSchema":
			property = editableAsset.FindByName("plasticvinyl_color")
		elif (editableAsset.FindByName("BaseSchema")).Value == "HardwoodSchema":
			property = editableAsset.FindByName("hardwood_color")
		elif (editableAsset.FindByName("BaseSchema")).Value == "StoneSchema":
			property = editableAsset.FindByName("stone_color")	
		elif (editableAsset.FindByName("BaseSchema")).Value == "SolidGlassSchema":
			property = editableAsset.FindByName("solidglass_transmittance_custom_color")
		elif (editableAsset.FindByName("BaseSchema")).Value == "PrismLayeredSchema":
			property = editableAsset.FindByName("layered_diffuse")
		elif (editableAsset.FindByName("BaseSchema")).Value == "PrismMetalSchema":
			property = editableAsset.FindByName("surface_roughness")
		elif (editableAsset.FindByName("BaseSchema")).Value == "PrismOpaqueSchema":
			property = editableAsset.FindByName("opaque_albedo")
		elif (editableAsset.FindByName("BaseSchema")).Value == "PrismTransparentSchema":
			property = editableAsset.FindByName("surface_roughness")
		connectedAsset = property.GetSingleConnectedAsset()
		
		if path == None:
			pass
		else:	
			BitMapLocation = connectedAsset.FindByName(UnifiedBitmap.UnifiedbitmapBitmap) 
			if BitMapLocation.IsValidValue(path):
				#AssetProperty String Object
				BitMapLocation.Value = path
		if scaleWidht == None:
			pass
		else:		
			BitmapScaleX = connectedAsset.FindByName(UnifiedBitmap.TextureRealWorldScaleX)
			BitmapScaleX.Value = UnitUtils.ConvertToInternalUnits(scaleWidht, UIunit)
		if scaleHeight == None:
			pass
		else:
			BitmapScaleY = connectedAsset.FindByName(UnifiedBitmap.TextureRealWorldScaleY)
			BitmapScaleY.Value = UnitUtils.ConvertToInternalUnits(scaleHeight, UIunit)

		editScope.Commit(IFailuresPreprocessor)
	TransactionManager.Instance.TransactionTaskDone()
	
for i in range(len(surfaces)):
	TransactionManager.Instance.EnsureInTransaction(doc)
	material = UnwrapElement(mats[i])
	OUT = PaintFace(surfaces[i], material)
	TransactionManager.Instance.TransactionTaskDone()
	

OUT = 0
# ----------------------------------------
