# Dynamo custom node UnfoldFacade.dyf (Dynamo 2.12.1.8246)
# category: ChengZ.FacadeUnfolding
# Unfold selected building facade into 2D surface
# Output in UnfoldParameters:
# [0] Unflodded facade
# [1] Index refers to the shape of the facade, 0 for flat and 1 for curved;
# [2] Start point in the unflodded paranomic image;
# [3] End point in the unflodded paranomic image;
# [4] Hegiht of the unflodded facade;
# [5] Point on the unflodded facade in Revit;
# [6] Radius of the arc if exist;

Facade2Unfold = Input(Facade2Unfold: var[]..[])
code_block = CodeBlock { 0; 0.5; 1; }

# group: Need to be reversed?
pointAtParameter = Surface.PointAtParameter(surface=Facade2Unfold, u=code_block.out2, v=code_block.out0)
pointAtParameter_2 = Surface.PointAtParameter(surface=Facade2Unfold, u=code_block.out0, v=code_block.out0)
code_block_2 = CodeBlock(p1=pointAtParameter, p2=pointAtParameter_2) { topz=p1.Z; botz=p2.Z; bool1=topz<botz; }

# group: Calculate Height of Unfoldded facade
pointAtParameter_3 = Surface.PointAtParameter(surface=Facade2Unfold, u=code_block.out2, v=code_block.out2)
pointAtParameter_4 = Surface.PointAtParameter(surface=Facade2Unfold, u=code_block.out0, v=code_block.out2)
distanceTo = Geometry.DistanceTo(geometry=pointAtParameter_4, other=pointAtParameter_3)

# group: Unfold facade
StartPointofUnfloddedSurface = Input(StartPointofUnfloddedSurface: var[]..[])
XAxis = Vector.XAxis()
YAxis = Vector.YAxis()

# group: Fit the horizental model line for the unfoldded facade
pointAtParameter_5 = Surface.PointAtParameter(surface=Facade2Unfold, u=code_block.out2, v=code_block.out1)
list_create = List.Create(item0=pointAtParameter, item1=pointAtParameter_5, item2=pointAtParameter_3)
fit_horizental_model_line = Python(IN[0]=list_create)  # CPython3
# ---------- fit_horizental_model_line.python (27 lines) ----------
# Load the Python Standard and DesignScript Libraries
import sys
import clr
clr.AddReference('ProtoGeometry')
from Autodesk.DesignScript.Geometry import *

# The inputs to this node will be stored as a list in the IN variables.
dataEnteringNode = IN

Points = IN[0]

# Check if the wall is curved
dX = abs(Points[1][0].X - ((Points[0][0].X+Points[2][0].X))/2);
dY = abs(Points[1][0].Y - ((Points[0][0].Y+Points[2][0].Y))/2);
dS = dX + dY;

if dS < 10:
    Arc1 = Line.ByStartPointEndPoint(Points[0][0],Points[2][0]);
    index = 0;
else:
    Arc1 = Arc.ByThreePoints(Points[0][0],Points[1][0],Points[2][0]);
    index = 1;
    
#Arc1 = Arc.ByThreePoints(Points[0][0],Points[1][0],Points[2][0]);

# Assign your output to the OUT variable.
OUT = [Arc1,index]
# ----------------------------------------
code_block_3 = CodeBlock(Result=fit_horizental_model_line) { index = Result[1]; curve = Result[0]; }
length = Curve.Length(curve=code_block_3.curve)

# group (continued): Unfold facade
byStartPointDirectionLength = Line.ByStartPointDirectionLength(startPoint=StartPointofUnfloddedSurface, direction=XAxis, length=length)
translate = Geometry.Translate(geometry=byStartPointDirectionLength, direction=YAxis, distance=distanceTo)
code_block_4 = CodeBlock(a=byStartPointDirectionLength, b=translate) { List.Flatten([a,b]); }
byLoft = Surface.ByLoft(crossSections=code_block_4)
endPoint = Curve.EndPoint(curve=byStartPointDirectionLength)

# group: Generate Unfold Curves
perimeterCurves = Surface.PerimeterCurves(surface=Facade2Unfold)
flatten = List.Flatten(list=perimeterCurves)
degree = NurbsCurve.Degree()  # unwired: nurbsCurve
map = List.Map(list=flatten, function=degree)
isNull = Object.IsNull(object=map)
filterByBoolMask = List.FilterByBoolMask(list=flatten, mask=isNull)
startPoint = Curve.StartPoint(curve=filterByBoolMask.in)
UVParameterAtPoint = Surface.UVParameterAtPoint(surface=Facade2Unfold, point=startPoint, lacing=Longest)
V = UV.V(uV=UVParameterAtPoint)
U = UV.U(uV=UVParameterAtPoint)
reverse_if_necessary = Python(IN[0]=code_block_2.bool1, IN[1]=U)  # IronPython2
# ---------- reverse_if_necessary.python (21 lines) ----------
# Load the Python Standard and DesignScript Libraries
import sys
import clr
clr.AddReference('ProtoGeometry')
from Autodesk.DesignScript.Geometry import *

# The inputs to this node will be stored as a list in the IN variables.
dataEnteringNode = IN

# Place your code below this line
bool1=IN[0][0]
list1=IN[1]
new=[]
if bool1==True:
	for item in list1:
		i=1-item
		new.append(i)
	OUT=new
else:
	OUT=list1
# Assign your output to the OUT variable.
# ----------------------------------------
pointAtParameter_6 = Surface.PointAtParameter(surface=byLoft, u=V, v=reverse_if_necessary)
endPoint_2 = Curve.EndPoint(curve=filterByBoolMask.in)
UVParameterAtPoint_2 = Surface.UVParameterAtPoint(surface=Facade2Unfold, point=endPoint_2, lacing=Longest)
V_2 = UV.V(uV=UVParameterAtPoint_2)
U_2 = UV.U(uV=UVParameterAtPoint_2)
reverse_if_necessary_2 = Python(IN[0]=code_block_2.bool1, IN[1]=U_2)  # IronPython2; same code as reverse_if_necessary
pointAtParameter_7 = Surface.PointAtParameter(surface=byLoft, u=V_2, v=reverse_if_necessary_2)
byStartPointEndPoint = Line.ByStartPointEndPoint(startPoint=pointAtParameter_6, endPoint=pointAtParameter_7)

# group: Generate Unfold Nurbscurve
controlPoints = NurbsCurve.ControlPoints(nurbsCurve=filterByBoolMask.out)
UVParameterAtPoint_3 = Surface.UVParameterAtPoint(surface=Facade2Unfold, point=controlPoints, lacing=Longest)
V_3 = UV.V(uV=UVParameterAtPoint_3)
U_3 = UV.U(uV=UVParameterAtPoint_3)
reverse_if_necessary_3 = Python(IN[0]=code_block_2.bool1, IN[1]=U_3)  # IronPython2
# ---------- reverse_if_necessary_3.python (25 lines) ----------
# Load the Python Standard and DesignScript Libraries
import sys
import clr
clr.AddReference('ProtoGeometry')
from Autodesk.DesignScript.Geometry import *

# The inputs to this node will be stored as a list in the IN variables.
dataEnteringNode = IN

# Place your code below this line
bool1=IN[0][0]
pointset=IN[1]
outlist=[]
for list1 in pointset:
	
	new=[]
	if bool1==True:
		for item in list1:
			i=1-item
			new.append(i)
		outlist.append(new)
	else:
		outlist.append(list1)
# Assign your output to the OUT variable.
OUT=outlist
# ----------------------------------------
pointAtParameter_8 = Surface.PointAtParameter(surface=byLoft, u=V_3, v=reverse_if_necessary_3)
byControlPoints = NurbsCurve.ByControlPoints()  # unwired: points
map_2 = List.Map(list=pointAtParameter_8, function=byControlPoints)

join = List.Join(list0=byStartPointEndPoint, list1=map_2)
Unfolding = Output(join)
EndPointofUnfolddedSurface = Output(endPoint)

# group (continued): Fit the horizental model line for the unfoldded facade
solve_model_line_equation = Python(IN[0]=code_block_3.index, IN[1]=list_create, IN[2]=StartPointofUnfloddedSurface, IN[3]=endPoint, IN[4]=distanceTo, IN[5]=Facade2Unfold)  # CPython3
# ---------- solve_model_line_equation.python (33 lines) ----------
# Load the Python Standard and DesignScript Libraries
import sys
import clr
import math
clr.AddReference('ProtoGeometry')
from Autodesk.DesignScript.Geometry import *

# The inputs to this node will be stored as a list in the IN variables.
dataEnteringNode = IN

# Place your code below this line
index = IN[0]; # 0 represent line, and 1 represent curve
Points = IN[1];
UnfoldStart = IN[2]
UnfoldEnd = IN[3]
height = IN[4]
facade = IN[5]

if index == 1:
	x1 = Points[0][0].X; y1 = Points[0][0].Y;
	x2 = Points[1][0].X; y2 = Points[1][0].Y;
	x3 = Points[2][0].X; y3 = Points[2][0].Y;
	a = x1-x2; b = y1-y2; c = x1-x3; d = y1-y3;
	e = (x1*x1-x2*x2+y1*y1-y2*y2)/2; f = (x1*x1-x3*x3+y1*y1-y3*y3)/2;
	x0 = -(d*e-b*f)/(b*c-a*d);
	y0 = -(a*f-c*e)/(b*c-a*d);
	radius = math.sqrt((x1-x0)*(x1-x0)+(y1-y0)*(y1-y0));
	record = [facade, index, UnfoldStart, UnfoldEnd, height, Points, radius];
else:
	record = [facade, index, UnfoldStart, UnfoldEnd, height, Points];
	
# Assign your output to the OUT variable.
OUT = record
# ----------------------------------------

UnfoldParameters = Output(solve_model_line_equation)
